# Grasshopper definition DALLG_Example.gh (Grasshopper 1.0.7)
# plug-ins: RhinoCodePluginGH, Human

roomtype_area_analysis = BooleanToggle(True)
# format the answer as a string object like this example:
# "0": x, y, area, roomType, neighbours[]
# eg. "0": 8, 1, 20, 4, n[0,3,4];  "1": 2, 19, 37, 4, n[1,2,4];
# 
# based on the following prompt:
# "plot a graph of architectural spaces in a 32x32 grid. Each node in the graph has an x and a y value between 1 and 32, an area for the room it represents, a roomtype which corresponds to the type of room, and a list of neighbours or adjacencies. Make sure the rooms are connected with edges, rooms should always list themselves as an adjacency"
# Architectural design user prompt
panel = Panel("\"0\": 26, 24, 35, 1, n[0, 1, 7]; \"1\": 18, 21, 24, 4, n[2, 1, 0]; \"2\": 13, 19, 32, 6, n[1, 2, 3]; \"3\": 18, 1, 56, 1, n[3, 2, 4]; \"4\": 1, 20, 28, 3, n[4, 3, 5]; \"5\": 21, 12, 48, 6, n[5, 4, 6]; \"6\": 15, 9, 25, 0, n[6, 5, 7]; \"7\": 8, 1, 20, 6, n[7, 6, 0];")
script = Script(chatGPToutput=panel)  # -> out, a, n, neighbors; inputs chatGPToutput: String
# ---------- script: C# ----------
// Grasshopper Script Instance
using System;
using System.Collections;
using System.Collections.Generic;
using System.Drawing;
using System.Linq;

using Rhino;
using Rhino.Geometry;

using Grasshopper;
using Grasshopper.Kernel;
using Grasshopper.Kernel.Data;
using Grasshopper.Kernel.Types;

public class Script_Instance : GH_ScriptInstance
{
  /* 
    Members:
      RhinoDoc RhinoDocument
      GH_Document GrasshopperDocument
      IGH_Component Component
      int Iteration

    Methods (Virtual & overridable):
      Print(string text)
      Print(string format, params object[] args)
      Reflect(object obj)
      Reflect(object obj, string method_name)
  */
  
  private void RunScript(
	string chatGPToutput,
	ref object a,
	ref object n,
	ref object neighbors)
  {
    // Write your logic here
    List<string> items = chatGPToutput.Split("; ").ToList();
    int numberRooms = items.Count;
    List<Point3d> nodes = new List<Point3d>();
    List<int> areas = new List<int>();
    List<string> neighboursLst = new List<string>();

    for(int i = 0; i < numberRooms; i++)
    {
        string info = items[i].Split(":").ToList()[1];
        var data = info.Split("n").ToList()[0];
        var values = data.Split(",").ToList();

        var x = Convert.ToInt32(values[0]);
        var y = Convert.ToInt32(values[1]);
        var area = Convert.ToInt32(values[2]);
        var neighbours = info.Split("n").ToList()[1].ToString();
        
        neighboursLst.Add(neighbours);

        nodes.Add(new Point3d(x, y , 0));
        areas.Add(area);
    }

    // FIND ROOM INTERSECTIONS
    Grasshopper.DataTree<int> treeInts = new Grasshopper.DataTree<int>();

    for (int i = 0; i < neighboursLst.Count(); i++)
    {
        GH_Path path = new GH_Path(i+1);
        string nLst = neighboursLst[i].Split("[")[1];
        string nLst2 = nLst.ToString().Split("]")[0];
        var nLst3 = nLst2.ToString().Split(",").ToList();
        List<int> nIdx = new List<int>();
        for(int j = 0; j < nLst3.Count; j++)
        {
            nIdx.Add(Convert.ToInt32(nLst3[j]));
        }
        treeInts.AddRange(nIdx, path);
    }
    
    a = areas;
    n = nodes;
    neighbors = treeInts;
  }
}
# ---------- end script ----------
point = Point(script.n)
list_length = ListLength(List=point)
series = Series(Start=0, Step=1, Count=list_length)
gradient = Gradient(
    LowerLimit=0,
    UpperLimit=list_length,
    Parameter=series,
    stops=[0: RGB(243, 57, 0), 0.1: RGB(236, 27, 60), 0.2: RGB(210, 0, 118), 0.3: RGB(103, 0, 120), 0.4: RGB(39, 72, 161), 0.5: RGB(1, 192, 229), 0.6: RGB(18, 178, 90), 0.7: RGB(79, 186, 8), 0.8: RGB(220, 237, 32), 0.9: RGB(247, 159, 20), 1: RGB(243, 57, 0)])
graft_tree = GraftTree(Tree=point, IncludeEmptyLists=True, IncludeNullItems=True)
colour_swatch = ColourSwatch(SwatchColor=RGB(125, 125, 125))
list_item = ListItem(List=point, Index=script.neighbors, Wrap=True)
line = Line(StartPoint=graft_tree, EndPoint=list_item)

# ---- group: preview graph edges
custom_preview_lineweights = CustomPreviewLineweights(Geometry=line, Shader=colour_swatch, Thickness=Slider(5.5, range=0..10), Absolute=False)

# ----
geo = Geometry(flatten([line, point]))
unit_x = UnitX(Factor=Slider(1.8, range=0..10))

# ---- group: visualise nodes
text_split = TextSplit(Text=gradient, Separators=",")
addition = Addition(A=text_split, B=Slider(82, range=-100..100))
list_item_2 = ListItem(List=addition, Index=0, Wrap=True)  # -> Item, Item1, Item2
move = Move(Geometry=point, Motion=unit_x)  # -> Geometry, Transform
colour_rgb = ColourRGB(Alpha=255, Red=list_item_2.Item, Green=list_item_2.Item1, Blue=list_item_2.Item2)
text_tag_3d = TextTag3D(
    Location=graft(move.Geometry),
    Text=graft(script.a),
    Size=Slider(0.44, range=0..1),
    Colour=colour_swatch,
    Justification=7)
dot_display = DotDisplay(Point=graft(point), Colour=graft(colour_rgb), Size=Slider(0.8, range=0..10))

# ----
panel_2 = Panel(script.a)
geo_2 = Geometry(geo)

number_slider = Slider(0.8, range=0..10)
number_slider_2 = Slider(0.5, range=0..1)
number_slider_3 = Slider(10, range=0..10)
colour_swatch_2 = ColourSwatch(SwatchColor=RGB(125, 125, 125))
colour_swatch_3 = ColourSwatch(SwatchColor=RGB(212, 212, 212))
dall_g = DALLG(crv=geo_2, room_areas=panel_2)  # -> T, curve_4, room_areas_3, i, V, R, R_2, nodes, a
grid = GRID(V=dall_g.V)  # -> C, V_2, V_3
preview_input = PREVIEWINPUT(
    crv=dall_g.T,
    list=dall_g.nodes,
    F=Slider(1.2, range=0..10),
    F_2=Slider(0.1, range=0..10),
    T=grid.V_2,
    upper_limit=number_slider_3)  # -> G_2, number_slider, geometry_2, V, geometry, G, number_slider_2, colour
text_tag_3d_2 = TextTag3D(
    Location=graft(preview_input.geometry_2),
    Text=graft(dall_g.R),
    Size=preview_input.number_slider_2,
    Colour=colour_swatch_3,
    Justification=7)
custom_preview_lineweights_2 = CustomPreviewLineweights(Geometry=preview_input.G_2, Shader=colour_swatch_2, Thickness=preview_input.number_slider, Absolute=False)
text_tag_3d_3 = TextTag3D(
    Location=graft(preview_input.geometry),
    Text=graft(dall_g.R_2),
    Size=preview_input.number_slider_2,
    Colour=colour_swatch_3,
    Justification=7)
dot_display_2 = DotDisplay(Point=graft(preview_input.G), Colour=graft(preview_input.colour), Size=number_slider)
crv = Curve(flatten(grid.C))
extrude_walls = Slider(0.15, range=0..1)
wall_height = Slider(2.2, range=0..10)
lng = ListLength(List=dall_g.nodes)
srf = Surface(crv)
swatch = ColourSwatch(SwatchColor=RGB(168, 168, 168))
create_surface = CREATESURFACE(T_2=grid.V_3, T=grid.V_2, G=dall_g.nodes, L_2=dall_g.a, L_3=srf, S=dall_g.a, L=dall_g.a)  # -> R, crv_2, S_2
gradient_2 = Gradient(
    LowerLimit=0,
    UpperLimit=number_slider_3,
    Parameter=dall_g.a,
    stops=[0: RGB(255, 255, 255), 0.0693: RGB(255, 255, 255), 0.243: RGB(210, 0, 118), 0.401: RGB(103, 0, 120), 0.511: RGB(39, 72, 161), 0.607: RGB(1, 192, 229), 0.715: RGB(18, 178, 90), 0.828: RGB(79, 186, 8), 0.994: RGB(220, 237, 32), 1: RGB(247, 159, 20), 1: RGB(243, 57, 0)])  # disabled
number_slider_4 = Slider(0.5, range=0..1)  # disabled
boundary = BoundarySurfaces(Edges=create_surface.crv_2)
cluster = Cluster(
    G=boundary,
    crv=create_surface.R,
    motion=preview_input.V,
    F=Slider(1, range=0..10),
    F_2=Slider(0.7, range=0..10),
    mesh=boundary,
    parameter=create_surface.S_2,
    room_areas_input=dall_g.room_areas_3,
    K=create_surface.S_2,
    G_3=roomtype_area_analysis,
    G_2=roomtype_area_analysis)  # -> C, line_2, geometry, colour, R, s_1_2, s_1
walls = WALLS(
    B=boundary,
    F=extrude_walls,
    C=create_surface.crv_2,
    D=extrude_walls,
    x=extrude_walls,
    diffuse=swatch,
    F_2=wall_height,
    C_2=create_surface.crv_2,
    transparency=Slider(0.1, range=0..1))  # -> E, material
material = CreateMaterial(Diffuse=gradient_2, Specular=RGB(255, 255, 255), Emission=RGB(0, 0, 0), Transparency=number_slider_4, Shine=0)  # disabled
preview = CustomPreview(Geometry=srf, Material=simplify(material))  # disabled
preview_2 = CustomPreview(Geometry=walls.E, Material=simplify(walls.material))
preview_3 = CustomPreview(Geometry=cluster.s_1_2, Material=simplify(graft(cluster.s_1)))
previewlw = CustomPreviewLineweights(Geometry=grid.C, Shader=swatch, Absolute=False)
crv_2 = Curve(cluster.line_2)
text_tag_3d_4 = TextTag3D(
    Location=graft(cluster.geometry),
    Text=graft(cluster.R),
    Size=Slider(0.44, range=0..1),
    Colour=colour_swatch_3,
    Justification=7)
dot_display_3 = DotDisplay(Point=cluster.C, Colour=graft(cluster.colour), Size=number_slider)
custom_preview_lineweights_3 = CustomPreviewLineweights(Geometry=crv_2, Shader=colour_swatch_2, Thickness=Slider(5.5, range=0..10), Absolute=False)

# ==== cluster PREVIEWINPUT
F = ClusterInput()
F_2 = ClusterInput()
upper_limit = ClusterInput()
Z = UnitZ(Factor=F)
Z_2 = UnitZ(Factor=F_2)
crv = ClusterInput()
V = ClusterOutput(Z)
list = ClusterInput()
list_length = ListLength(List=list)
series = Series(Start=0, Step=1, Count=list_length)
gradient = Gradient(
    LowerLimit=0,
    UpperLimit=upper_limit,
    Parameter=series,
    stops=[0: RGB(243, 57, 0), 0.1: RGB(236, 27, 60), 0.2: RGB(210, 0, 118), 0.3: RGB(103, 0, 120), 0.4: RGB(39, 72, 161), 0.5: RGB(1, 192, 229), 0.6: RGB(18, 178, 90), 0.7: RGB(79, 186, 8), 0.8: RGB(220, 237, 32), 0.9: RGB(247, 159, 20), 1: RGB(243, 57, 0)])
crv_2 = Curve(crv)
T = ClusterInput()
move = Move(Geometry=list, Motion=T)  # -> Geometry, Transform
move_2 = Move(Geometry=move.Geometry, Motion=Z_2)  # -> graft(Geometry), Transform
text_split = TextSplit(Text=gradient, Separators=",")
addition = Addition(A=text_split, B=Slider(82, range=-100..100))
move_3 = Move(Geometry=crv_2, Motion=Z_2)  # -> Geometry, Transform
G = ClusterOutput(move_2.Geometry)
G_2 = ClusterOutput(move_3.Geometry)
list_item = ListItem(List=addition, Index=0, Wrap=True)  # -> Item, Item1, Item2
X = UnitX(Factor=Slider(1, range=0..10))
move_4 = Move(Motion=X)  # -> Geometry, Transform
Y = UnitY(Factor=Slider(0.7, range=0..10))
number_slider = ClusterOutput(Slider(5.5, range=0..10))
colour_rgb = ColourRGB(Alpha=255, Red=list_item.Item, Green=list_item.Item1, Blue=list_item.Item2)
move_5 = Move(Motion=Z)  # -> Geometry, Transform
move_6 = Move(Geometry=move_5.Geometry, Motion=expr("-x", Y))  # -> Geometry, Transform
colour = ClusterOutput(colour_rgb)
geometry = ClusterOutput(move_6.Geometry)
number_slider_2 = ClusterOutput(Slider(0.44, range=0..1))
geometry_2 = ClusterOutput(move_5.Geometry)

# ==== cluster WALLS
F = ClusterInput()
B = ClusterInput()
Z = UnitZ(Factor=F)
extr = Extrude(Base=B, Direction=expr("-x", Z))
diffuse = ClusterInput()
transparency = ClusterInput()
create_material = CreateMaterial(Diffuse=diffuse, Specular=RGB(255, 255, 255), Emission=RGB(0, 0, 0), Transparency=transparency, Shine=0)
x = ClusterInput()
material = ClusterOutput(create_material)
neg = Negative(Value=x)
C = ClusterInput()
D = ClusterInput()
C_2 = ClusterInput()
offset = OffsetCurve(Curve=C, Distance=D, Corners=1)
offset_2 = OffsetCurve(Curve=C_2, Distance=neg, Corners=1)
F_2 = ClusterInput()
sdiff = SolidDifference(BrepsA=offset, BrepsB=offset_2)
Z_2 = UnitZ(Factor=F_2)
extr_2 = Extrude(Base=sdiff, Direction=Z_2)
preview = CustomPreview(Geometry=extr, Material=simplify(graft(create_material)))
E = ClusterOutput(extr_2)

# ==== cluster Cluster
mesh = ClusterInput()
mesh_2 = Mesh(mesh)
G = ClusterInput()
area = Area(Geometry=G)  # -> Area, Centroid
crv = ClusterInput()
mjoin = MeshJoin(Meshes=mesh_2)  # -> flatten(Mesh)
K = ClusterInput()
C = ClusterOutput(area.Centroid)
script = Script(crv=flatten(crv))  # -> out, graphIndices; inputs crv: list of Curve, boundary: Curve, seed: Int32
# ---------- script: C# ----------
// Grasshopper Script Instance
using System;
using System.Collections;
using System.Collections.Generic;
using System.Drawing;
using System.Linq;
using System.Data;
using System.Text.Json;
using System.Text.Json.Serialization;

using Rhino;
using Rhino.Geometry;

using Grasshopper;
using Grasshopper.Kernel;
using Grasshopper.Kernel.Data;
using Grasshopper.Kernel.Types;

public class Script_Instance : GH_ScriptInstance
{
  /* 
    Members:
      RhinoDoc RhinoDocument
      GH_Document GrasshopperDocument
      IGH_Component Component
      int Iteration

    Methods (Virtual & overridable):
      Print(string text)
      Print(string format, params object[] args)
      Reflect(object obj)
      Reflect(object obj, string method_name)
  */
  
  private void RunScript(
	IList<Curve> crv,
	Curve boundary,
	int seed,
	ref object graphIndices)
  {
    var crvs = crv.ToList();

    // FIND ROOM INTERSECTIONS
    Grasshopper.DataTree<int> treeInts = new Grasshopper.DataTree<int>();
    Dictionary<int, List<int>> intersections = FindRoomConnections(crvs);

    for (int i = 0; i < crvs.Count(); i++)
    {
        GH_Path path = new GH_Path(i+1);
        treeInts.AddRange(intersections[i], path);
    }
    graphIndices = treeInts;


  }

  public List<Dictionary<string, double>> CoordinatesAsDict(List<Point3d> pts)
  {
    List<Dictionary<string, double>> mask = new List<Dictionary<string, double>>();
    for(int i = 0; i < pts.Count(); i++)
    {
        Dictionary<string, double> coordPoints = new Dictionary<string, double>();
        double x = pts[i].X - 0.5;
        double y = pts[i].Y - 0.5;
        coordPoints["x"] = x;
        coordPoints["y"] = y;
        
        mask.Add(coordPoints);
    }
    return mask;
  }

public double GetArea(Curve curve)
{
    Brep b = Rhino.Geometry.Brep.CreatePlanarBreps(curve)[0];
    return b.GetArea();
}

public int AssignRoomType(int max)
{
    Random rand = new Random();
    return rand.Next(max);
}

public int[] GetCenterPointXy(Curve curve)
{
    Curve[] segments = curve.DuplicateSegments();
    List<Point3d> pts = segments.Select(x => x.PointAtEnd).ToList();
    pts.Add(pts[0]);
    Polyline polyLine = new Polyline(pts);
    Point3d center = polyLine.CenterPoint();
    int x = Convert.ToInt32(Math.Round(center.X));
    int y = Convert.ToInt32(Math.Round(center.Y));
    int[] xy = new int[2]{x, y};
    return xy;
}

public Dictionary<int, List<int>> FindRoomConnections(List<Curve> crvs)
{
    Dictionary<int, List<int>> intersections = new Dictionary<int, List<int>>();

    for (int i = 0; i < crvs.Count(); i++)
    {
        List<int> curveIntersectionIndices = new List<int>();
        List<Curve> curveIntersectionCurves = new List<Curve>();
        Curve iCurve = crvs[i];

        List<Curve> newList = crvs.ToList();
        newList.RemoveAt(i);

        for (int j = 0; j < newList.Count(); j++)
        {
            Curve jCurve = crvs[j];
            const double intersection_tolerance = 0.001;
            const double overlap_tolerance = 0.0;

            if (jCurve != iCurve)
            {
                var events = Rhino.Geometry.Intersect.Intersection.CurveCurve(iCurve, jCurve, intersection_tolerance, overlap_tolerance);
            
                // Process the results
                if (events.Count() >= 1)
                {
                    curveIntersectionIndices.Add(j);
                    curveIntersectionCurves.Add(newList[j]);
                }
            }
        }
        curveIntersectionIndices.Add(i);
        intersections[i] = curveIntersectionIndices;
    }

    return intersections;
}
}
# ---------- end script ----------
room_areas_input = ClusterInput()
sort = SortList(Keys=K, ValuesA=mjoin)  # -> Keys, ValuesA
parameter = ClusterInput()
point = Point(flatten(area.Centroid))
room_areas_input_2 = Panel(room_areas_input)
F = ClusterInput()
area_2 = Area(Geometry=sort.ValuesA)  # -> Area, Centroid
area_3 = Area(Geometry=mesh_2)  # -> Area, Centroid
F_2 = ClusterInput()
gradient = Gradient(
    LowerLimit=0,
    UpperLimit=Slider(10, range=0..10),
    Parameter=graft(parameter),
    stops=[0: RGB(243, 57, 0), 0.1: RGB(236, 27, 60), 0.2: RGB(210, 0, 118), 0.3: RGB(103, 0, 120), 0.4: RGB(39, 72, 161), 0.5: RGB(1, 192, 229), 0.6: RGB(18, 178, 90), 0.7: RGB(79, 186, 8), 0.8: RGB(220, 237, 32), 0.9: RGB(247, 159, 20), 1: RGB(243, 57, 0)])
text_split = TextSplit(Text=gradient, Separators=",")
addition = Addition(A=text_split, B=Slider(82, range=-100..100))
list_item = ListItem(List=addition, Index=0, Wrap=True)  # -> Item, Item1, Item2
graft_tree = GraftTree(Tree=point, IncludeEmptyLists=True, IncludeNullItems=True)
list_item_2 = ListItem(List=point, Index=script.graphIndices, Wrap=True)
X = UnitX(Factor=F)
move = Move(Geometry=flatten(area.Centroid), Motion=X)  # -> Geometry, Transform
Y = UnitY(Factor=F_2)
colour_rgb = ColourRGB(Alpha=255, Red=list_item.Item, Green=list_item.Item1, Blue=list_item.Item2)
room_areas_input_3 = Panel(area_2.Area)
division = Division(A=graft(area_2.Area), B=graft(room_areas_input_2))
motion = ClusterInput()
move_2 = Move(Geometry=move.Geometry, Motion=expr("-x", Y))  # -> Geometry, Transform
line = Line(StartPoint=graft_tree, EndPoint=list_item_2)
concat = Concatenate(FragmentA="area: ", FragmentB=area_3.Area)
move_3 = Move(Geometry=flatten(move.Geometry), Motion=motion)  # -> Geometry, Transform
subtraction = Subtraction(A=1, B=division)  # -> flatten(Result)
abs = Absolute(Value=subtraction)
bnd = Bounds(Numbers=flatten(abs))
remap = RemapNumbers(Value=flatten(abs), Source=bnd, Target=Domain(0, 1))  # -> Mapped, Clipped
gradient_2 = Gradient(LowerLimit=0, UpperLimit=1, Parameter=remap.Mapped, stops=[0: RGB(0, 128, 0), 0.5: RGB(255, 255, 0), 1: RGB(255, 0, 0)])
colour = ClusterOutput(colour_rgb)
create_material = CreateMaterial(Diffuse=gradient, Specular=RGB(255, 255, 255), Emission=RGB(0, 0, 0), Transparency=Slider(0.5, range=0..1), Shine=0)
room_areas_difference = Panel(subtraction)
custom_preview = CustomPreview(Geometry=mesh_2, Material=simplify(graft(create_material)))
line_2 = ClusterOutput(line)
R = ClusterOutput(concat)
G_2 = ClusterInput()
G_3 = ClusterInput()
geometry = ClusterOutput(move_3.Geometry)
filter = StreamFilter(Gate=G_2, Stream0=graft(gradient_2), Stream1=create_material)
filter_2 = StreamFilter(Gate=G_3, Stream0=graft(sort.ValuesA), Stream1=mesh_2)
preview = CustomPreview(Geometry=filter_2, Material=filter)
s_1 = ClusterOutput(filter)
s_1_2 = ClusterOutput(filter_2)

# ==== cluster CREATESURFACE
L = ClusterInput()
S = ClusterInput()
cset = CreateSet(List=L)  # -> Set, Map
mindex = MemberIndex(Set=S, Member=cset.Set)  # -> Index, Count
L_2 = ClusterInput()
L_3 = ClusterInput()
item = ListItem(List=L_2, Index=mindex.Index, Wrap=True)
item_2 = ListItem(List=L_3, Index=mindex.Index, Wrap=True)
equals = Equality(FirstNumber=item, SecondNumber=0)  # -> Equality, Inequality
G = ClusterInput()
cull = CullPattern(List=item_2, CullPattern=invert(equals.Equality))
clean = CleanTree(RemoveNulls=True, RemoveInvalid=True, RemoveEmpty=True, Tree=cull)
T = ClusterInput()
runion = RegionUnion(Curves=clean)
boundary = BoundarySurfaces(Edges=runion)
move = Move(Geometry=G, Motion=T)  # -> Geometry, Transform
T_2 = ClusterInput()
flatten = FlattenTree(Tree=boundary, Path="{0}")
move_2 = Move(Geometry=move.Geometry, Motion=T_2)  # -> Geometry, Transform
lng = ListLength(List=flatten(move_2.Geometry))
area = Area(Geometry=flatten)  # -> Area, Centroid
dist = Distance(PointA=graft(area.Centroid), PointB=move_2.Geometry)
series = Series(Start=0, Step=1, Count=lng)
sort = SortList(Keys=dist, ValuesA=flatten(series))  # -> Keys, ValuesA
item_3 = ListItem(List=sort.ValuesA, Index=0, Wrap=True)
cset_2 = CreateSet(List=flatten(item_3))  # -> Set, Map
mindex_2 = MemberIndex(Set=flatten(item_3), Member=cset_2.Set)  # -> Index, Count
S_2 = ClusterOutput(cset_2.Set)
item_4 = ListItem(List=flatten, Index=mindex_2.Index, Wrap=mindex_2.Index)
runion_2 = RegionUnion(Curves=item_4)
R = ClusterOutput(runion_2)
crv = Curve(runion_2)
crv_2 = ClusterOutput(crv)

# ==== cluster GRID
V = ClusterInput()
rev = Reverse(Vector=V)
xy = XYPlane(Origin=Point(0, 0, 0))
grid_size = Slider(32, range=16..256)
X = UnitX(Factor=Slider(40, range=0..100))
V_2 = ClusterOutput(rev)
move = Move(Geometry=xy, Motion=rev)  # -> Geometry, Transform
V_3 = ClusterOutput(X)
move_2 = Move(Geometry=move.Geometry, Motion=X)  # -> Geometry, Transform
sqgrid = Square(Plane=move_2.Geometry, Size=1, ExtentX=grid_size, ExtentY=grid_size)  # -> Cells, Points
C = ClusterOutput(sqgrid.Cells)

# ==== cluster DALLG
crv = ClusterInput()
crv_2 = Curve(crv)
clean = CleanTree(RemoveNulls=flatten(True), RemoveInvalid=True, RemoveEmpty=False, Tree=flatten(crv_2))
explode = Explode(Curve=clean, Recursive=True)  # -> Segments, Vertices
clean_2 = CleanTree(RemoveNulls=flatten(True), RemoveInvalid=True, RemoveEmpty=False, Tree=flatten(explode.Vertices))
clean_3 = CleanTree(RemoveNulls=flatten(True), RemoveInvalid=True, RemoveEmpty=False, Tree=flatten(explode.Segments))
curve = Curve([<curve referenced from the Rhino model> x30])

# ---- group: ORIGINAL
curve_2 = Curve(<curve referenced from the Rhino model>)
pcen = PolygonCenter(Polyline=curve_2)  # -> CenterV, CenterE, CenterA

# ----
pt = Point(crv)
clean_4 = CleanTree(RemoveNulls=flatten(True), RemoveInvalid=True, RemoveEmpty=False, Tree=flatten(pt))
cullpt = CullDuplicates(Points=[clean_2, clean_4], Tolerance=0.1, CullMode=3)  # -> Points, Indices, Valence
item = ListItem(List=cullpt.Points, Index=0, Wrap=True)
incurve = PointInCurve(Point=item, Curve=curve)  # -> Relationship, Point
cull = CullPattern(List=curve, CullPattern=incurve.Relationship)
pcen_2 = PolygonCenter(Polyline=cull)  # -> CenterV, CenterE, CenterA
vec2pt = Vector2Pt(PointA=pcen_2.CenterV, PointB=pcen.CenterV, Unitize=False)  # -> Vector, Length
curve_3 = Curve(clean_3)
point = Point(cullpt.Points)
V = ClusterOutput(vec2pt.Vector)
move = Move(Geometry=clean_3, Motion=vec2pt.Vector)  # -> Geometry, Transform
curve_4 = ClusterOutput(curve_3)
T = ClusterOutput(clean_3)
room_areas = ClusterInput()
crv_3 = Curve(move.Geometry)
explode_2 = Explode(Curve=crv_3, Recursive=True)  # -> flatten(Segments), Vertices
move_2 = Move(Geometry=point, Motion=vec2pt.Vector)  # -> Geometry, Transform
room_areas_2 = Panel(room_areas)
clean_5 = CleanTree(RemoveNulls=True, RemoveInvalid=True, RemoveEmpty=False, Tree=explode_2.Segments)
detect_connections = Script(nodesIn=move_2.Geometry, edges=clean_5)  # -> out, nodes, indices; inputs nodesIn: list of Point3d, edges: list of Curve
# ---------- detect_connections: C# ----------
// Grasshopper Script Instance
using System;
using System.Collections;
using System.Collections.Generic;
using System.Drawing;
using System.Linq;

using Rhino;
using Rhino.Geometry;

using Grasshopper;
using Grasshopper.Kernel;
using Grasshopper.Kernel.Data;
using Grasshopper.Kernel.Types;

public class Script_Instance : GH_ScriptInstance
{
  private void RunScript(
	IList<Point3d> nodesIn,
	IList<Curve> edges,
	ref object nodes,
	ref object indices)
  {
    // FIND ROOM INTERSECTIONS
    Grasshopper.DataTree<int> treeInts = new Grasshopper.DataTree<int>();
    var edgeList = edges.ToList();
    List<Point3d> n = UniquePointsCrv(edgeList);
    List<Point3d> lonelyNodes = FindLonelyPoints(nodesIn.ToList(), n);
    Dictionary<int, List<int>> intersections = FindGraphConnections(n, edges.ToList());
    
    for (int i = 0; i < n.Count(); i++)
    {
        GH_Path path = new GH_Path(i);
        treeInts.AddRange(intersections[i], path);
    }

    for (int i = 0; i < lonelyNodes.Count(); i++)
    {
        GH_Path path = new GH_Path(i + n.Count);
        treeInts.Add(i + n.Count(), path);
    }

    indices = treeInts;
    n.AddRange(lonelyNodes);
    nodes = n;
  }

  public List<Point3d> FindLonelyPoints(List<Point3d> pts, List<Point3d> n)
  {

    List<Point3d> uniquePts = new List<Point3d>();

    for (int i = 0; i < pts.Count(); i++)
    {
        var contains = false;
        for (int j = 0; j < n.Count(); j++)
        {
            var test = pts[i].CompareTo(n[j]);

            if (test == 0)
            {
                contains = true;
            }
        }

        if(!contains)
        {
            uniquePts.Add(pts[i]);
        }
    }
    return uniquePts;
  }

  public List<Point3d> UniquePointsCrv(List<Curve> crvs)
  {
    List<Point3d> allPts = crvs.Select(x => x.PointAtStart).ToList();
    List<Point3d> endP = crvs.Select(x => x.PointAtEnd).ToList();
    allPts.AddRange(endP);

    List<double> allX = allPts.Select(x => x.X).ToList();
    List<double> allY = allPts.Select(x => x.Y).ToList();
    List<double> allZ = allPts.Select(x => x.Z).ToList();

    List<double> historyX = new List<double>();
    List<double> historyY = new List<double>();
    List<double> historyZ = new List<double>();

    List<Point3d> uniquePts = new List<Point3d>();
    for (int i = 0; i < allX.Count(); i++)
    {
        bool contains = (historyX.Contains(allX[i]) && historyY.Contains(allY[i]) && historyZ.Contains(allZ[i]));
        if(!contains)
        {
            uniquePts.Add(new Point3d(allX[i], allY[i], 0));
            historyX.Add(allX[i]);
            historyY.Add(allY[i]);
            historyZ.Add(allZ[i]);
        }
    }
    return uniquePts;
  }
  public Dictionary<int, List<int>> FindGraphConnections(List<Point3d> nodes, List<Curve> crvs)
{

    Dictionary<int, List<int>> intersections = new Dictionary<int, List<int>>();

    for (int i = 0; i < nodes.Count; i++)
    {
        List<int> connections = new List<int>();

        for (int j = 0; j < crvs.Count(); j++)
        {
            var startPt = crvs[j].PointAtStart;
            var endPt = crvs[j].PointAtEnd;

            if(startPt.DistanceTo(nodes[i]) <= 1)
            {
                int idx = nodes.IndexOf(endPt);
                if(!connections.Contains(idx))
                {
                    connections.Add(idx);
                }
            }
            else if(endPt.DistanceTo(nodes[i]) <= 1)
            {
                int idx = nodes.IndexOf(startPt);
                if(!connections.Contains(idx))
                {
                    connections.Add(idx);
                }
            }
        }
        connections.Add(i);
        intersections.Add(i, connections);
    }

    return intersections;
}
}
# ---------- end detect_connections ----------
pt_2 = Point(detect_connections.nodes)
cluster = Cluster_3(G=curve_3, T=vec2pt.Vector, pt=pt_2)  # -> i, N
i = ClusterOutput(cluster.i)
lng = ListLength(List=detect_connections.nodes)
# take generated graph and send web request
room_areas_3 = ClusterOutput(room_areas_2)
nodes = ClusterOutput(detect_connections.nodes)
split = SplitList(List=room_areas_2, Index=lng)  # -> ListA, ListB
cluster_2 = Cluster_2(B=split.ListA, T=detect_connections.indices)  # -> R_3, R_2, R
R = ClusterOutput(cluster_2.R_3)
R_2 = ClusterOutput(cluster_2.R_2)
dall_g = Script(nodes=detect_connections.nodes, connectionIdx=flatten(cluster_2.R), area=split.ListA)  # -> out, a; inputs nodes: list of Point3d, connectionIdx: list of String, area: list of Double
# ---------- dall_g: C# ----------
// Grasshopper Script (With Nuget Package)
#r "nuget: RestSharp, 106.11.7"
using RestSharp;
using RestSharp.Authenticators;


// Grasshopper Script Instance
using System;
using System.Collections;
using System.Collections.Generic;
using System.Drawing;
using System.Linq;
using System.Text.Json;
using System.Text.Json.Serialization;

using Rhino;
using Rhino.Geometry;

using Grasshopper;
using Grasshopper.Kernel;
using Grasshopper.Kernel.Data;
using Grasshopper.Kernel.Types;

public class Script_Instance : GH_ScriptInstance
{
  /* 
    Members:
      RhinoDoc RhinoDocument
      GH_Document GrasshopperDocument
      IGH_Component Component
      int Iteration

    Methods (Virtual & overridable):
      Print(string text)
      Print(string format, params object[] args)
      Reflect(object obj)
      Reflect(object obj, string method_name)
  */
  
  private void RunScript(
	IList<Point3d> nodes,
	IList<string> connectionIdx,
	IList<double> area,
	ref object a)
  {
    var client = new RestClient("http://localhost:8080/predict");

    Random rand = new Random();
    var adjacencies = connectionIdx.ToList();

    //CREATE JSON DICTIONARY
    Dictionary<string, object> node2Props = new Dictionary<string, object>();
    node2Props["vertexCount"] = adjacencies.Count();
    // Populate node2Props in its entirety
    for (int i = 0; i < adjacencies.Count(); i++)
    {
        string roomIndex = (i).ToString();
        if (!node2Props.ContainsKey(roomIndex))
        {
            node2Props[roomIndex] = new Dictionary<string, object>();
        }
        Dictionary<string, object> props = node2Props[roomIndex] as Dictionary<string, object>;
        props["x"] = nodes[i].X;
        props["y"] = nodes[i].Y;
        props["area"] = area[i];
        props["roomType"] = roomIndex;
        props["neighbours"] = connectionIdx[i].Split(", ").Select(x => Convert.ToInt32(x)).ToList();
    }

    var request = new RestRequest();
    request.AddParameter("application/json; charset=utf-8", System.Text.Json.JsonSerializer.Serialize(node2Props), ParameterType.RequestBody);
    request.AddHeader("Accept", "application/json");
    var response = client.Post(request);
    var prediction = System.Text.Json.JsonSerializer.Deserialize<PredictionResponse>(response.Content);

    var gridValues = prediction.Prediction.Select(x => x.ToString()).ToList();
    
    //var groups = gridValues.GroupBy(s => s, s => s.Count());
    //Dictionary<string, string> query = groups.ToDictionary(x => x.Key.ToString(), x => x.Count);

    //List<double> ratios = new List<double>();
    //for(int i = 0; i < area.Count; i++)
    //{
    //    string roomType = Convert.ToString(i);
    //    var ratio = query[roomType] / area[i];
    //    ratios.Add(ratio);
    //}
    //double averageRatio = ratios.Average();

    a = gridValues;
  }


    public record PredictionResponse(List<int> Prediction);
}
# ---------- end dall_g ----------
room_areas_4 = Panel(cluster_2.R_3)
a = ClusterOutput(dall_g.a)

# ==== cluster Cluster_2
T = ClusterInput()
B = ClusterInput()
join = TextJoin(Text=T, Join=", ")
concat = Concatenate(FragmentA="area: ", FragmentB=B)
concat_2 = Concatenate(FragmentA="adjacencies: ", FragmentB=join)
R = ClusterOutput(join)
R_2 = ClusterOutput(concat_2)
R_3 = ClusterOutput(concat)

# ==== cluster Cluster_3
G = ClusterInput()
T = ClusterInput()
move = Move(Geometry=G, Motion=T)  # -> Geometry, Transform
area = Area(Geometry=move.Geometry)  # -> Area, Centroid
pt = ClusterInput()
area_2 = Area(Geometry=move.Geometry)  # -> Area, Centroid
pt_2 = Point(pt)
scale = Scale(Geometry=move.Geometry, Center=area.Centroid, Factor=Slider(1.4, range=0..10))  # -> Geometry, Transform
dist = Distance(PointA=area_2.Centroid, PointB=graft(pt_2))
incurve = PointInCurve(Point=graft(pt_2), Curve=scale.Geometry)  # -> Relationship, Point
sort = SortList(Keys=dist, ValuesA=move.Geometry)  # -> Keys, ValuesA
cull = CullPattern(List=move.Geometry, CullPattern=incurve.Relationship)
item = ListItem(List=sort.ValuesA, Index=0, Wrap=True)
area_3 = Area(Geometry=item)  # -> flatten(Area), Centroid
round = Round(Number=area_3.Area)  # -> Nearest, Floor, Ceiling
i = ClusterOutput(item)
N = ClusterOutput(round.Nearest)
